# Dynamo graph Presets.dyn (Dynamo 0.9.0.3067)

bottom_radius = DoubleSlider(0.9, range=0..15 step 0.1)
byCenterPointRadius = Circle.ByCenterPointRadius(radius=bottom_radius)
top_radius = DoubleSlider(1.3, range=0..15 step 0.1)
byCenterPointRadius_2 = Circle.ByCenterPointRadius(radius=top_radius)
height = DoubleSlider(18, range=0..20 step 0.1)
translate = Geometry.Translate(geometry=byCenterPointRadius_2, zTranslation=height)
circle_2_radius = DoubleSlider(2.3, range=0..15 step 0.1)
byCenterPointRadius_3 = Circle.ByCenterPointRadius(radius=circle_2_radius)
code_block = CodeBlock(x=height) { x*0.3; }
translate_2 = Geometry.Translate(geometry=byCenterPointRadius_3, zTranslation=code_block)
circle_3_radius = DoubleSlider(1.1, range=0..15 step 0.1)
byCenterPointRadius_4 = Circle.ByCenterPointRadius(radius=circle_3_radius)
code_block_2 = CodeBlock(x=height) { x*0.7; }
translate_3 = Geometry.Translate(geometry=byCenterPointRadius_4, zTranslation=code_block_2)
create = List.Create(byCenterPointRadius, translate_2, translate_3, translate)
byLoft = Surface.ByLoft(create)
create_2 = List.Create(byCenterPointRadius, translate, byLoft)
code_block_3 = CodeBlock { 50; }
translate_4 = Geometry.Translate(geometry=create_2, zTranslation=code_block_3)
