# Dynamo graph 4.1.3-A.dyn (Dynamo 0.8.1.1233)

# note: There are several different ways to make a number.
number_slider = DoubleSlider(7.2, range=0..10 step 0.1)
number_slider_2 = DoubleSlider(1.4, range=0..10 step 0.1)
number = DoubleInput(0)
# note: The three numbers make the three properties required for a point.
byCoordinates = Point.ByCoordinates(x=number_slider, y=number_slider_2, z=number)
number_slider_3 = DoubleSlider(1.8, range=0..10 step 0.1)
# note: Create a circle from Point.
byCenterPointRadius = Circle.ByCenterPointRadius(centerPoint=byCoordinates, radius=number_slider_3)
ZAxis = Vector.ZAxis()
number_slider_4 = DoubleSlider(6.4, range=0..10 step 0.1)
# note: Curve.ExtrudeAsSolid creates solids.
extrudeAsSolid = Curve.ExtrudeAsSolid(curve=byCenterPointRadius, direction=ZAxis, distance=number_slider_4)
watch = Watch(extrudeAsSolid)
# note: Curve.Extrude creates surfaces.
extrude = Curve.Extrude(curve=byCenterPointRadius, direction=ZAxis, distance=number_slider_4)
watch_2 = Watch(extrude)
