# Dynamo graph 4.5.3.dyn (Dynamo 0.8.1.1233)

number = DoubleInput(0)
number_2 = DoubleInput(10)
number_slider = DoubleSlider(0.91, range=0.5..5 step 0.01)
# note: Defining a number range creates a list.
number_range = NumberRange(number, number_2, number_slider, lacing=Longest)
# note: By changing the lacing to "Cross Product", we create a grid of points.
byCoordinates = Point.ByCoordinates(x=number_range, y=number_range, lacing=CrossProduct)
# note: Change the boolean here to toggle different schemes.
boolean = BoolSelector(false)
# note: There are several different ways to make a number.
number_slider_2 = DoubleSlider(0, range=0..10 step 0.1)
number_slider_3 = DoubleSlider(3.6, range=0..10 step 0.1)
integer_slider = IntegerSlider(3, range=0..10 step 1)
# note: The three numbers make the three properties required for a point.
byCoordinates_2 = Point.ByCoordinates(x=number_slider_2, y=number_slider_3, z=integer_slider)
# note: Calculate distance from reference point to grid point.
distanceTo = Geometry.DistanceTo(geometry=byCoordinates_2, other=byCoordinates)
formula = Formula("IF(numbers>5,.15,x/2)", numbers=distanceTo, x=number_slider)
number_3 = DoubleInput(4)
div = number_slider / number_3
# note: Remapping a range is a fundamental method for parametric modeling: we're using a one data source to drive another.  The data is remapped so that circles fit within the grid.
# note: In the two batteries above, one case uses the 'division' battery, while the other uses the 'formula' battery.  The two are operating in the same way here, but we have more flexibility with the 'formula' battery.
formula_2 = Formula("x/2", x=number_slider)
# note: An alternative option to the remap range statment is a conditional formula.  The formula above will separate the cylinders into two different radius values.
remapRange = Math.RemapRange(numbers=distanceTo, newMin=div, newMax=formula_2)
formula_3 = Formula("IF(boolean,x,y)", boolean=boolean, x=formula, y=remapRange)
# note: Create circles with radius relative to distance from reference point.
byCenterPointRadius = Circle.ByCenterPointRadius(centerPoint=byCoordinates, radius=formula_3)
ZAxis = Vector.ZAxis()
# note: Curve.ExtrudeAsSolid creates solids.
extrudeAsSolid = Curve.ExtrudeAsSolid(curve=byCenterPointRadius, direction=ZAxis, distance=distanceTo)
watch = Watch(extrudeAsSolid)
# note: Curve.Extrude creates surfaces.
extrude = Curve.Extrude(curve=byCenterPointRadius, direction=ZAxis, distance=distanceTo)
watch_2 = Watch(extrude)
flatten = Flatten(extrudeAsSolid)
# note: With this formula, we can toggle two separate design approoaches for defining the radius of each circle.
number_slider_4 = DoubleSlider(255, range=0..255 step 0.1)
number_4 = DoubleInput(0)
byARGB = Color.ByARGB(r=number_slider_4, g=number_slider_4, b=number_4)
byARGB_2 = Color.ByARGB(r=number_4, g=number_slider_4, b=number_slider_4)
create = List.Create(byARGB, byARGB_2)
flatten_2 = Flatten(formula_3)
number_5 = DoubleInput(0)
number_6 = DoubleInput(1)
remapRange_2 = Math.RemapRange(numbers=flatten_2, newMin=number_5, newMax=number_6)
color_range = ColorRange(create, arg2=remapRange_2)
byGeometryColor = Display.ByGeometryColor(flatten, color_range)
