# Dynamo graph BuildingBlocks of Programs - ColorOnSurface.dyn (Dynamo 0.9.0.3067)

code_block = CodeBlock { 0..10..#25; }
code_block_2 = CodeBlock(x=code_block) { x*36; }
sin = Math.Sin(code_block_2)
amplitude = DoubleSlider(2.6, range=0..10 step 0.1)
code_block_3 = CodeBlock(x=sin, a=amplitude) { x*a; }
byCoordinates = Point.ByCoordinates(x=code_block_3, z=code_block)
byControlPoints = NurbsCurve.ByControlPoints(byCoordinates)
cos = Math.Cos(code_block_2)
code_block_4 = CodeBlock(x=cos, a=amplitude) { x*a; }
surface_width = DoubleSlider(14.5, range=0..20 step 0.1)
byCoordinates_2 = Point.ByCoordinates(x=code_block_4, y=surface_width, z=code_block)
byControlPoints_2 = NurbsCurve.ByControlPoints(byCoordinates_2)
create = List.Create(byControlPoints, byControlPoints_2)
byLoft = Surface.ByLoft(create)
file_path = Filename("C:\Users\Armon\Documents\GitHub\DynamoPrimer\04_The-Building-Blocks-of-Programs\datasets\4-5\starryNight.jpg")
fromPath = FileObject(file_path)  # "File.FromPath"
readFromFile = Image.ReadFromFile(fromPath)
x_samples = DoubleSlider(100, range=0..500 step 0.1)
y_samples = DoubleSlider(150, range=0..500 step 0.1)
pixels = Image.Pixels(image=readFromFile, xSamples=x_samples, ySamples=y_samples)
bySurfaceColors = Display.Display.BySurfaceColors(byLoft, pixels)
