# Dynamo graph List-ShiftIndices.dyn (Dynamo 0.8.1.1942)

code_block = CodeBlock { 500; }
byCoordinates = Point.ByCoordinates(x=code_block)
byOriginNormal = Plane.ByOriginNormal(origin=byCoordinates)
code_block_2 = CodeBlock { 50; }
byPlaneRadius = Circle.ByPlaneRadius(plane=byOriginNormal, radius=code_block_2)
code_block_3 = CodeBlock { 0..1..#100; }
pointAtParameter = Curve.PointAtParameter(curve=byPlaneRadius, param=code_block_3)
code_block_4 = CodeBlock { 100; }
translate = Geometry.Translate(geometry=byPlaneRadius, zTranslation=code_block_4)
pointAtParameter_2 = Curve.PointAtParameter(curve=translate, param=code_block_3)
byStartPointEndPoint = Line.ByStartPointEndPoint(startPoint=pointAtParameter, endPoint=pointAtParameter_2)
code_block_5 = CodeBlock { 30; }
shiftIndices = List.ShiftIndices(list=pointAtParameter_2, amount=code_block_5)
byStartPointEndPoint_2 = Line.ByStartPointEndPoint(startPoint=pointAtParameter, endPoint=shiftIndices)
