# Dynamo graph Listatlevel.dyn (Dynamo 1.2.0.2690)

origin = Point.Origin()
code_block = CodeBlock { 0; 4; 1; }
range = Range(start=code_block.out0, end=code_block.out1, step=code_block.out2, lacing=Longest)
x_vector_bycoordinates = Vector.ByCoordinates(x=range, y=code_block.out0, z=code_block.out0)
translate = Geometry.Translate(geometry=origin, direction=x_vector_bycoordinates, lacing=Longest)
y_vector_bycoordinates = Vector.ByCoordinates(x=code_block.out0, y=range, z=code_block.out0)
translate_2 = Geometry.Translate(geometry=translate, direction=y_vector_bycoordinates, lacing=CrossProduct)
z_vector_bycoordinates = Vector.ByCoordinates(x=code_block.out0, y=code_block.out0, z=range)
translate_3 = Geometry.Translate(geometry=translate_2, direction=z_vector_bycoordinates, lacing=CrossProduct)

# group: List@Level Method
code_block_2 = CodeBlock { 0; }
getItemAtIndex = List.GetItemAtIndex(list=translate_3@L2, index=code_block_2)

code_block_3 = CodeBlock { 0; }

# group: List.Map Method
getItemAtIndex_2 = List.GetItemAtIndex(list=translate_3, index=code_block_3)
getItemAtIndex_3 = List.GetItemAtIndex(index=code_block_3)  # unwired: list
map = List.Map(list=translate_3, f_x=getItemAtIndex_3)
getItemAtIndex_4 = List.GetItemAtIndex(index=code_block_3)  # unwired: list
map_2 = List.Map(f_x=getItemAtIndex_4)  # unwired: list
map_3 = List.Map(list=translate_3, f_x=map_2)
