# Dynamo graph 7-2_Dynamo-Syntax_Attractor-Surface.dyn (Dynamo 0.8.2.1810)

number = DoubleInput(-50)
number_2 = DoubleInput(11)
number_3 = DoubleInput(10)
number_sequence = NumberSeq(number, number_2, number_3, lacing=Longest)
byCoordinates = Point.ByCoordinates(x=number_sequence, y=number_sequence, lacing=CrossProduct)
ZAxis = Vector.ZAxis()
number_slider = DoubleSlider(-3.6, range=-50..50 step 0.1)
number_slider_2 = DoubleSlider(50, range=-50..50 step 0.1)
byCoordinates_2 = Point.ByCoordinates(x=number_slider, y=number_slider_2, lacing=CrossProduct)
distanceTo = Geometry.DistanceTo(geometry=byCoordinates_2, other=byCoordinates)
translate = Geometry.Translate(geometry=byCoordinates, direction=ZAxis, distance=distanceTo)
byControlPoints = NurbsSurface.ByControlPoints(controlVertices=translate)
number_4 = DoubleInput(5)
thicken = Surface.Thicken(surface=byControlPoints, thickness=number_4)
watch_3d = Watch3D(thicken)
number_slider_3 = DoubleSlider(-3.6, range=-50..50 step 0.1)
number_slider_4 = DoubleSlider(50, range=-50..50 step 0.1)
code_block = CodeBlock(x=number_slider_3, y=number_slider_4)
# ---------- code_block.designscript (6 lines) ----------
refPt=Point.ByCoordinates(x,y,0);
coordsXY=(-50..50..#11);
gridPts=Point.ByCoordinates(coordsXY<1>,coordsXY<2>,0);
transPts=gridPts.Translate(Vector.ZAxis(),refPt.DistanceTo(gridPts));
srf=NurbsSurface.ByControlPoints(transPts);
solid=srf.Thicken(5);
# ----------------------------------------
watch_3d_2 = Watch3D(code_block.srf)
code_block_2 = CodeBlock { t1 = -50; t2 = 11; t3 = 10; }
number_sequence_2 = NumberSeq(code_block_2.t1, code_block_2.t2, code_block_2.t3, lacing=Longest)
number_slider_5 = DoubleSlider(-3.6, range=-50..50 step 0.1)
number_slider_6 = DoubleSlider(50, range=-50..50 step 0.1)
code_block_3 = CodeBlock(t2=number_sequence_2, t5=number_slider_5, t6=number_slider_6)
# ---------- code_block_3.designscript (8 lines) ----------
t1 = Point.ByCoordinates(t2<1>, t2<2>, 0);
t3 = Vector.ZAxis();
t4 = Point.ByCoordinates(t5<1>, t6<2>, 0);
t7 = t4.DistanceTo(t1);
t8 = t1.Translate(t3, t7);
t9 = NurbsSurface.ByControlPoints(t8, 3, 3);
t10 = 5;
t11 = t9.Thicken(t10);
# ----------------------------------------
watch_3d_3 = Watch3D(code_block_3.t11)
