# Dynamo graph 7-3_Obsolete-Nodes_Sine-Surface.dyn (Dynamo 0.8.2.1810)

code_block = CodeBlock { ..Math.Sin(x*1080)..#50)*5; }
code_block_2 = CodeBlock { 10; }
byCoordinates = Point.ByCoordinates(z=code_block_2)
ZAxis = Vector.ZAxis()
byOriginNormal = Plane.ByOriginNormal(origin=byCoordinates, normal=ZAxis)
code_block_3 = CodeBlock { 50; }
byWidthLength = Rectangle.ByWidthLength(plane=byOriginNormal, width=code_block_3, length=code_block_3)
byPatch = Surface.ByPatch(byWidthLength)
code_block_4 = CodeBlock(x=code_block_3) { 0..1..#x; }
pointAtParameter = Surface.PointAtParameter(surface=byPatch, u=code_block_4, v=code_block_4, lacing=CrossProduct)
ZAxis_2 = Vector.ZAxis()
transpose = List.Transpose()
add = _ + transpose
translate = Geometry.Translate(geometry=pointAtParameter, direction=ZAxis_2, distance=add)
number_slider = DoubleSlider(1, range=0..1 step 0.01)
code_block_5 = CodeBlock(sineStrips=translate, u=number_slider) { sineStrips[0..((List.Count(sineStrips)-1)*u)]; }
byPoints = NurbsSurface.ByPoints(code_block_5)
XY = Plane.XY()
ZAxis_3 = Vector.ZAxis()
integer_slider = IntegerSlider(2, range=1..5 step 1)
integer_slider_2 = IntegerSlider(8, range=0..10 step 1)
number_slider_2 = DoubleSlider(1, range=0..1 step 0.01)

# group: Code Blocks
code_block_6 = CodeBlock { 100; }
code_block_7 = CodeBlock { 0..1..#50; }
code_block_8 = CodeBlock(x=code_block_7, cycles=integer_slider, amp=integer_slider_2)
# ---------- code_block_8.designscript (3 lines) ----------
sineList=(0..Math.Sin(x*360*cycles)..#List.Count(x))*amp;
transposeList=List.Transpose(sineList);
eggShellList=sineList+transposeList;
# ----------------------------------------

byWidthLength_2 = Rectangle.ByWidthLength(plane=XY, width=code_block_6, length=code_block_6)
byPatch_2 = Surface.ByPatch(byWidthLength_2)
pointAtParameter_2 = Surface.PointAtParameter(surface=byPatch_2, u=code_block_7, v=code_block_7, lacing=CrossProduct)
translate_2 = Geometry.Translate(geometry=pointAtParameter_2, direction=ZAxis_3, distance=code_block_8.eggShellList)

# group (continued): Code Blocks
code_block_9 = CodeBlock(sineStrips=translate_2, u=number_slider_2) { sineStrips[0..((List.Count(sineStrips)-1)*u)]; }

byPoints_2 = NurbsSurface.ByPoints(code_block_9)
number_slider_3 = DoubleSlider(1, range=0..1 step 0.01)
code_block_10 = CodeBlock(sineStrips=translate, u=number_slider_3) { sineStrips[0..((List.Count(sineStrips)-1)*u)]; }
