# Dynamo graph 7-4_Functions_SphereByZ.dyn (Dynamo 0.8.2.1810)

code_block = CodeBlock()
# ---------- code_block.designscript (15 lines) ----------
/* This is the parent
code block, defining a function.
The text here is a multi-line comment
and does not affect the code. */

def sphereByZ(inputPt)
{
 //get inputPt variables
 sphereRadius=(inputPt.Z)/20;

 //define sphere
 sphere=Sphere.ByCenterPointRadius(inputPt,sphereRadius);
 //finally, define the function's output with 'return'
 return=sphere;
};
# ----------------------------------------
code_block_2 = CodeBlock { 0..100..#10; }
byCoordinates = Point.ByCoordinates(x=code_block_2, z=code_block_2, lacing=CrossProduct)
code_block_3 = CodeBlock(thePoint=byCoordinates) { sphereByZ(thePoint); }
code_block_4 = CodeBlock { 0..100..#10; }
byCoordinates_2 = Point.ByCoordinates(y=code_block_4, z=code_block_4)
code_block_5 = CodeBlock(thePoint=byCoordinates_2) { sphereByZ(thePoint); }
code_block_6 = CodeBlock()
# ---------- code_block_6.designscript (7 lines) ----------
def sphereByZ(inputPt)
{
//get Z Value, use it to drive radius of sphere
sphereRadius=inputPt.Z/20;
sphere=Sphere.ByCenterPointRadius(inputPt,sphereRadius);
return = sphere;
};
# ----------------------------------------
code_block_7 = CodeBlock { 0..100..#10; }
byCoordinates_3 = Point.ByCoordinates(x=code_block_7, y=code_block_7, z=code_block_7, lacing=CrossProduct)
code_block_8 = CodeBlock(Pt=byCoordinates_3) { sphereByZ(Pt); }
code_block_9 = CodeBlock { -100..0..#10; }
byCoordinates_4 = Point.ByCoordinates(x=code_block_9, z=code_block_7, lacing=CrossProduct)
