# Dynamo graph Exercise-8.1.dyn (Dynamo 0.8.2.1873)

select_model_element = DSModelElementSelection()  # 1 picked in the model
watch = Watch(select_model_element)
faces = Element.Faces(watch)
integer_slider = IntegerSlider(9, range=0..18 step 1)
getItemAtIndex = List.GetItemAtIndex(list=faces, index=integer_slider)
count = List.Count(faces)
geometry = Element.Geometry(watch)
explode = Geometry.Explode(geometry)
select_faces = SelectFaces()  # 4 picked in the model
watch_2 = Watch(select_faces)
select_model_element_2 = DSModelElementSelection()  # 1 picked in the model
watch_3 = Watch(select_model_element_2)
code_block = CodeBlock(x=watch_3) { x.Symbol; }
symbol = FamilyInstance.Symbol(watch_3)
all_elements_of_family_type = ElementsOfFamilyType(symbol)
watch_4 = Watch(all_elements_of_family_type)
geometry_2 = Element.Geometry(watch_3)
categories = Categories("Mass")
all_elements_of_category = ElementsOfCategory(categories)
watch_5 = Watch(all_elements_of_category)
faces_2 = Element.Faces(watch_5)
watch_6 = Watch(faces_2)
select_model_element_3 = DSModelElementSelection()  # 1 picked in the model
watch_7 = Watch(select_model_element_3)
geometry_3 = Element.Geometry(watch_7)
explode_2 = Geometry.Explode(geometry_3)
faces_3 = Element.Faces(watch_7)
count_2 = List.Count(faces_3)
integer_slider_2 = IntegerSlider(9, range=0..18 step 1)
getItemAtIndex_2 = List.GetItemAtIndex(list=faces_3, index=integer_slider_2)
select_face = DSFaceSelection()  # 1 picked in the model
watch_8 = Watch(select_face)
select_model_element_4 = DSModelElementSelection()  # 1 picked in the model
watch_9 = Watch(select_model_element_4)
geometry_4 = Element.Geometry(watch_9)
select_model_element_5 = DSModelElementSelection()  # 1 picked in the model
watch_10 = Watch(select_model_element_5)
geometry_5 = Element.Geometry(watch_10)
code_block_2 = CodeBlock(x=watch_9) { x.Symbol; }
symbol_2 = FamilyInstance.Symbol(watch_9)
all_elements_of_family_type_2 = ElementsOfFamilyType(symbol_2)
watch_11 = Watch(all_elements_of_family_type_2)
geometry_6 = Element.Geometry(all_elements_of_family_type_2)
watch_3d = Watch3D(geometry_6)
locations = AdaptiveComponent.Locations(all_elements_of_family_type)
byPoints = Polygon.ByPoints(locations)
