# Dynamo graph Editing.dyn (Dynamo 0.8.2.2032)

select_model_element = DSModelElementSelection()  # 1 picked in the model
watch = Watch(select_model_element)
parameters = Element.Parameters(watch)
code_block = CodeBlock { {"BldgWidth","BldgLength","BldgHeight", "AtriumOffset", "InsideOffset","LiftUp"}; }
bldgWidth = DoubleSlider(62, range=0..100 step 0.1)
bldgLength = DoubleSlider(92, range=0..100 step 0.1)
bldgHeight = DoubleSlider(25, range=0..100 step 0.1)
atriumOffset = DoubleSlider(22, range=0..100 step 0.1)
insideOffset = DoubleSlider(8, range=0..100 step 0.1)
liftUp = DoubleSlider(12, range=0..100 step 0.1)
code_block_2 = CodeBlock(bw=bldgWidth, bl=bldgLength, bh=bldgHeight, ao=atriumOffset, io=insideOffset, lu=liftUp) { {bw,bl,bh,ao,io,lu}; }
setParameterByName = Element.SetParameterByName(element=watch, parameterName=code_block, value=code_block_2)
code_block_3 = CodeBlock { {"DblSkin_SouthOffset","DblSkin_MidOffset","DblSkin_NorthOffset","Facade Bend Location"}; }
dblSkin_SouthOffset = DoubleSlider(2.68, range=0..10 step 0.01)
dblSkin_MidOffset = DoubleSlider(2.64, range=0..10 step 0.01)
dblSkin_NorthOffset = DoubleSlider(2.29, range=0..10 step 0.01)
facade_bend_location = DoubleSlider(0.5, range=0.1..0.9 step 0.01)
code_block_4 = CodeBlock(so=dblSkin_SouthOffset, mo=dblSkin_MidOffset, no=dblSkin_NorthOffset, fbl=facade_bend_location) { {so,mo,no,fbl}; }
setParameterByName_2 = Element.SetParameterByName(element=watch, parameterName=code_block_3, value=code_block_4)
