# Dynamo graph Creating.dyn (Dynamo 0.8.2.2032)

select_edge = DSEdgeSelection()  # 1 picked in the model
select_edge_2 = DSEdgeSelection()  # 1 picked in the model
select_edge_3 = DSEdgeSelection()  # 1 picked in the model
create = List.Create(select_edge_2, select_edge_3)
byJoinedCurves = PolyCurve.ByJoinedCurves(create)
select_edge_4 = DSEdgeSelection()  # 1 picked in the model
select_edge_5 = DSEdgeSelection()  # 1 picked in the model
create_2 = List.Create(select_edge_4, select_edge_5)
byJoinedCurves_2 = PolyCurve.ByJoinedCurves(create_2)
create_3 = List.Create(select_edge, byJoinedCurves, byJoinedCurves_2)
integer_slider = IntegerSlider(10, range=0..30 step 1)
code_block = CodeBlock(numberOfTrusses=integer_slider) { 0..1..#numberOfTrusses; }
planeAtParameter = Curve.PlaneAtParameter(curve=select_edge, param=code_block)
intersect = Geometry.Intersect(geometry=create_3, other=planeAtParameter, lacing=CrossProduct)
flatten = Flatten()
map = List.Map(list=intersect, f_x=flatten)
transpose = List.Transpose(map)
byPoints = Polygon.ByPoints(transpose)
family_types = FamilyTypes("AdaptiveTruss-Tension:AdaptiveTruss-Tension")
byPoints_2 = AdaptiveComponent.ByPoints(transpose, family_types)
