# Dynamo custom node PointsToSurface.dyf (Dynamo 0.8.3.2256)
# category: DynamoPrimer
# Map Points from Source Surface to Target Surface

targetSurface = Input(targetSurface : Surface)
sourceSurface = Input(sourceSurface : Surface)
points = Input(points : Autodesk.Point)
UVParameterAtPoint = Surface.UVParameterAtPoint(sourceSurface, points)
U = UV.U(UVParameterAtPoint)
V = UV.V(UVParameterAtPoint)
pointAtParameter = Surface.PointAtParameter(surface=targetSurface, u=U, v=V)
Points = Output(pointAtParameter)
