# Dynamo graph Building Blocks of Programs - Logic.dyn (Dynamo 0.8.1.1265)

number = DoubleInput(0)
code_block = CodeBlock { 360; }
number_2 = DoubleInput(5)
number_range = NumberRange(number, code_block, number_2, lacing=Longest)
degreesToRadians = Math.DegreesToRadians(number_range)
number_slider = DoubleSlider(4, range=0..4 step 0.01)
mul = number_range * number_slider
sin = Math.Sin(mul)
number_slider_2 = DoubleSlider(0.59, range=0..1 step 0.01)
mul_2 = sin * number_slider_2
byCoordinates = Point.ByCoordinates(x=degreesToRadians, y=mul_2)
byPoints = PolyCurve.ByPoints(points=byCoordinates)
number_3 = DoubleInput(0)
number_4 = DoubleInput(100)
number_5 = DoubleInput(1)
number_sequence = NumberSeq(number_3, number_4, number_5, lacing=Longest)
number_6 = DoubleInput(0)
number_7 = DoubleInput(1)
remapRange = Math.RemapRange(numbers=number_sequence, newMin=number_6, newMax=number_7)
pointAtParameter = Curve.PointAtParameter(curve=byPoints, param=remapRange)
number_8 = DoubleInput(2)
mod = number_sequence % number_8
number_9 = DoubleInput(0)
eq = mod == number_9
filterByBoolMask = List.FilterByBoolMask(list=pointAtParameter, mask=eq)
number_10 = DoubleInput(0.025)
number_11 = DoubleInput(0.6)
number_12 = DoubleInput(0.3)
byLengths = Cuboid.ByLengths(origin=filterByBoolMask.out, width=number_10, length=number_11, height=number_12)
number_13 = DoubleInput(0.1)
number_14 = DoubleInput(0.01)
byLengths_2 = Cuboid.ByLengths(origin=filterByBoolMask.in, width=number_13, length=number_13, height=number_14)
