# Dynamo graph Mesh-Toolkit_Intersect-Mesh.dyn (Dynamo 0.8.3.2391)

file_path = Filename("C:\Users\Mode Lab_01\Documents\MODE LAB\CONSULTING\AUTODESK\DYNAMO PRIMER\stanford_bunny_tri.obj")
importFile = Autodesk.Dynamo.MeshToolkit.Mesh.ImportFile(file_path)
code_block = CodeBlock { -5; -3; }
byCoordinates = Point.ByCoordinates(x=code_block.out0, y=code_block.out1)
code_block_2 = CodeBlock { 40; }
code_block_3 = CodeBlock { 90; }
code_block_4 = CodeBlock { 180; }
YAxis = Vector.YAxis()
byCenterPointRadiusAngle = Arc.ByCenterPointRadiusAngle(center=byCoordinates, radius=code_block_2, startAngle=code_block_3, endAngle=code_block_4, normal=YAxis)
code_block_5 = CodeBlock { 0..1..#25; }
pointAtParameter = Curve.PointAtParameter(curve=byCenterPointRadiusAngle, param=code_block_5)
tangentAtParameter = Curve.TangentAtParameter(byCenterPointRadiusAngle, code_block_5)
byOriginNormal = Plane.ByOriginNormal(origin=pointAtParameter, normal=tangentAtParameter)
intersect = Autodesk.Dynamo.MeshToolkit.Mesh.Intersect(importFile, byOriginNormal, lacing=Longest)
curves = PolyCurve.Curves(intersect)
endPoint = Curve.EndPoint(curves)
boolean = BoolSelector(true)
byPoints = NurbsCurve.ByPoints(endPoint, boolean)
byPatch = Surface.ByPatch(byPoints)
code_block_6 = CodeBlock { 40; }
code_block_7 = CodeBlock { 0; }
code_block_8 = CodeBlock { 90; }
ZAxis = Vector.ZAxis()
byCenterPointRadiusAngle_2 = Arc.ByCenterPointRadiusAngle(center=byCoordinates, radius=code_block_6, startAngle=code_block_7, endAngle=code_block_8, normal=ZAxis)
code_block_9 = CodeBlock { 0..1..#25; }
pointAtParameter_2 = Curve.PointAtParameter(curve=byCenterPointRadiusAngle_2, param=code_block_9)
tangentAtParameter_2 = Curve.TangentAtParameter(byCenterPointRadiusAngle_2, code_block_9)
byOriginNormal_2 = Plane.ByOriginNormal(origin=pointAtParameter_2, normal=tangentAtParameter_2)
intersect_2 = Autodesk.Dynamo.MeshToolkit.Mesh.Intersect(importFile, byOriginNormal_2, lacing=Longest)
curves_2 = PolyCurve.Curves(intersect_2)
endPoint_2 = Curve.EndPoint(curves_2)
boolean_2 = BoolSelector(true)
byPoints_2 = NurbsCurve.ByPoints(endPoint_2, boolean_2)
byPatch_2 = Surface.ByPatch(byPoints_2)
