# Dynamo graph Building Blocks of Programs - Data.dyn (Dynamo 0.8.1.1265)

number = DoubleInput(0)
integer_slider = IntegerSlider(9, range=0..10 step 1)
radius = DoubleSlider(0.95, range=0..2 step 0.01)
thickness = DoubleSlider(1.49, range=0..2 step 0.01)
add = radius + thickness
number_2 = DoubleInput(2)
mul = add * number_2
number_sequence = NumberSeq(number, integer_slider, mul, lacing=Longest)
pointY = DoubleSlider(0, range=0..2 step 0.01)
pointZ = DoubleSlider(0.04, range=0..2 step 0.01)
byCoordinates = Point.ByCoordinates(x=number_sequence, y=pointY, z=pointZ)
ZAxis = Vector.ZAxis()
byOriginNormal = Plane.ByOriginNormal(origin=byCoordinates, normal=ZAxis)
byPlaneRadius = Circle.ByPlaneRadius(plane=byOriginNormal, radius=radius)
height = DoubleSlider(1.74, range=0..2 step 0.01)
extrude = Curve.Extrude(curve=byPlaneRadius, distance=height)
thicken = Surface.Thicken(surface=extrude, thickness=thickness)
