# Dynamo graph Geometry for Computational Design - Surfaces.dyn (Dynamo 0.8.2.1770)

file_path = Filename("C:\Users\gAkos\Documents\GitHub\dynamo-primer\05_Geometry-for-Computational-Design\datasets\Surface.sat")
importFromSAT = Geometry.ImportFromSAT(file_path)
code_block = CodeBlock { 100; }
scale = Geometry.Scale(geometry=importFromSAT, amount=code_block)
code_block_2 = CodeBlock { 0; }
number_slider = DoubleSlider(0.33, range=0..1 step 0.01)
getIsoline = Surface.GetIsoline(scale, code_block_2, number_slider)
code_block_3 = CodeBlock { 1; }
number_slider_2 = DoubleSlider(0.61, range=0..1 step 0.01)
getIsoline_2 = Surface.GetIsoline(scale, code_block_3, number_slider_2)
pointAtParameter = Surface.PointAtParameter(surface=scale, u=number_slider_2, v=number_slider)
normalAtParameter = Surface.NormalAtParameter(surface=scale, u=number_slider_2, v=number_slider)
byStartPointDirectionLength = Line.ByStartPointDirectionLength(startPoint=pointAtParameter, direction=normalAtParameter)
