# Dynamo graph DirectShape.dyn (Dynamo 1.0.0.660)

# group: Revit Link
select_model_element = DSModelElementSelection()  # 1 picked in the model
curve = CurveElement.Curve(select_model_element)
code_block = CodeBlock { 0..1..#10; }
select_model_element_2 = DSModelElementSelection()  # 1 picked in the model
curve_2 = CurveElement.Curve(select_model_element_2)
select_model_element_3 = DSModelElementSelection()  # 1 picked in the model
faces = Element.Faces(select_model_element_3)

# group: Parameters
code_block_diagonal_shift = CodeBlock { -2; }
camber = DoubleSlider(3, range=0..3 step 0.01)
radius = DoubleSlider(0.2, range=0..0.5 step 0.01)

# group: Geometry Creation
pointAtParameter = Curve.PointAtParameter(curve=curve, param=code_block)
pointAtParameter_2 = Curve.PointAtParameter(curve=curve_2, param=code_block)
code_block_2 = CodeBlock(point1=pointAtParameter, t4=code_block_diagonal_shift, point2=pointAtParameter_2)
# ---------- code_block_2.designscript (7 lines) ----------
t3 = List.ShiftIndices(point1, t4);
x = point1;
y = t4;
t1 = (List.Count(x)) + y;
t2 = (List.Count(x)) + y;
t5 = List.TakeItems(t3, t1);
line1 = Line.ByStartPointEndPoint(point2, t5);
# ----------------------------------------
code_block_3 = CodeBlock(line1=code_block_2.line1, t2=camber)
# ---------- code_block_3.designscript (5 lines) ----------
point1 = line1.StartPoint;
point2 = line1.PointAtParameter(0.5);
geometry1 = point2.Translate(0, 0, t2);
point3 = line1.EndPoint;
arc1 = Arc.ByThreePoints(point1, geometry1, point3);
# ----------------------------------------
code_block_4 = CodeBlock(arc1=code_block_3.arc1, t2=radius) { plane1 = arc1.PlaneAtParameter(0); circle1 = Circle.ByPlaneRadius(plane1, t2); solid1 = circle1.SweepAsSolid(arc1); }
code_block_5 = CodeBlock(point1=pointAtParameter_2, t4=code_block_diagonal_shift, point2=pointAtParameter)  # same code as code_block_2
code_block_6 = CodeBlock(line1=code_block_5.line1, t2=camber)  # same code as code_block_3
code_block_7 = CodeBlock(arc1=code_block_6.arc1, t2=radius) { plane1 = arc1.PlaneAtParameter(0); circle1 = Circle.ByPlaneRadius(plane1, t2); solid1 = circle1.SweepAsSolid(arc1); }
create = List.Create(pointAtParameter_2, pointAtParameter)
flatten = Flatten(create)
byCenterPointRadius = Sphere.ByCenterPointRadius(centerPoint=flatten, radius=radius)
create_2 = List.Create(code_block_4.solid1, code_block_7.solid1, byCenterPointRadius)
flatten_2 = Flatten(create_2)
byUnion = Solid.ByUnion(flatten_2)

# group: Revit Export
categories = Categories("StructuralFraming")
categories_2 = Categories("Materials")
all_elements_of_category = ElementsOfCategory(categories_2)
code_block_8 = CodeBlock(a=all_elements_of_category) { a[0]; }
name = Element.Name(code_block_8)
byName = Material.ByName(name)
code_block_9 = CodeBlock { "Roof_Structure"; }
byGeometry = DirectShape.ByGeometry(geometry=byUnion, category=categories, material=byName, name=code_block_9)
