# Dynamo graph UV-Mapping.dyn (Dynamo 0.8.2.2032)

code_block = CodeBlock { -40..40..#5; }
code_block_2 = CodeBlock { 20; }
peakAndTroughSrf = Custom[PeakAndTroughSrf]()
code_block_3 = CodeBlock { 100; }
byWidthLength = Rectangle.ByWidthLength(width=code_block_3, length=code_block_3)
byPatch = Surface.ByPatch(byWidthLength)
code_block_4 = CodeBlock { 10; }
code_block_5 = CodeBlock(x=code_block_4) { -50+50/x..50-50/x..#x; }
byCoordinates = Point.ByCoordinates(x=code_block_5, y=code_block_5, lacing=CrossProduct)
byOriginNormal = Plane.ByOriginNormal(origin=byCoordinates)
code_block_6 = CodeBlock(x=code_block_4) { 100/x; }
byWidthLength_2 = Rectangle.ByWidthLength(plane=byOriginNormal, width=code_block_6, length=code_block_6)
points = Polygon.Points(byWidthLength_2)
UVParameterAtPoint = Surface.UVParameterAtPoint(byPatch, points)
U = UV.U(UVParameterAtPoint)
V = UV.V(UVParameterAtPoint)
pointAtParameter = Surface.PointAtParameter(surface=peakAndTroughSrf, u=U, v=V)
boolean = BoolSelector(true)
byPoints = PolyCurve.ByPoints(points=pointAtParameter, connectLastToFirst=boolean)
byPatch_2 = Surface.ByPatch(byPoints)
