# Dynamo graph Customizing.dyn (Dynamo 0.8.2.2032)

select_edge = DSEdgeSelection()  # 1 picked in the model
select_edge_2 = DSEdgeSelection()  # 1 picked in the model
create = List.Create(select_edge, select_edge_2)
byLoft = Surface.ByLoft(create)
code_block = CodeBlock { 0..1..#10; }
pointAtParameter = Surface.PointAtParameter(surface=byLoft, u=code_block, v=code_block, lacing=CrossProduct)
UVParameterAtPoint = Surface.UVParameterAtPoint(byLoft, pointAtParameter)
U = UV.U(UVParameterAtPoint)
V = UV.V(UVParameterAtPoint)
number_slider = DoubleSlider(5, range=0..50 step 0.1)
code_block_2 = CodeBlock(u=U, v=V, w=number_slider) { Math.Sin(u*180)*Math.Sin(v*180)*w; }
translate = Geometry.Translate(geometry=pointAtParameter, zTranslation=code_block_2)
byPoints = NurbsSurface.ByPoints(translate)
code_block_3 = CodeBlock { 15; }
lunchbox_quad_grid_by_face = Custom[LunchBox Quad Grid by Face](Face=byPoints, U=code_block_3, V=code_block_3)  # Create a quadrangular XYZ grid on a face. The face surface must have an untrimmed UV parameter space.
family_types = FamilyTypes("ROOF-PANEL-4PT:ROOF-PANEL-4PT")
# note: Needs connection to "Panel Pts" from "LunchBox Quad Grid by Face". Remember to set Run to "Manual"
byPoints_2 = AdaptiveComponent.ByPoints(lunchbox_quad_grid_by_face, family_types)
code_block_4 = CodeBlock { "Aperture Ratio"; }
current = SunSettings()  # "SunSettings.Current"
sunDirection = SunSettings.SunDirection(current)
watch = Watch(lunchbox_quad_grid_by_face)
byBestFitThroughPoints = Plane.ByBestFitThroughPoints(watch)
normal = Plane.Normal(byBestFitThroughPoints)
dot = Vector.Dot(sunDirection, normal)
abs = Math.Abs(dot)
code_block_5 = CodeBlock { 0.15; 0.45; }
remapRange = Math.RemapRange(numbers=abs, newMin=code_block_5.out0, newMax=code_block_5.out1)
setParameterByName = Element.SetParameterByName(element=byPoints_2, parameterName=code_block_4, value=remapRange)
