# Dynamo graph SteepestPath.dyn (Dynamo 1.2.0.2831)

# group: Surface inputs
code_block = CodeBlock { 0..10..1; }
x_position = DoubleSlider(8, range=0..10 step 0.1)
y_position = DoubleSlider(3, range=0..10 step 0.1)
x_position_2 = DoubleSlider(2.8, range=0..10 step 0.1)
y_position_2 = DoubleSlider(4.9, range=0..10 step 0.1)
amplitude = DoubleSlider(5, range=0..20 step 0.1)

# group: Surface from two attractors
byCoordinates = Point.ByCoordinates(x=code_block, y=code_block, lacing=CrossProduct)
ZAxis = Vector.ZAxis()
byCoordinates_2 = Point.ByCoordinates(x=x_position, y=y_position)
distanceTo = Geometry.DistanceTo(geometry=byCoordinates, other=byCoordinates_2)
flatten = Flatten(distanceTo)
byCoordinates_3 = Point.ByCoordinates(x=x_position_2, y=y_position_2)
distanceTo_2 = Geometry.DistanceTo(geometry=byCoordinates, other=byCoordinates_3)
flatten_2 = Flatten(distanceTo_2)
join = List.Join(flatten, flatten_2)
minimumItem = List.MinimumItem(join)
maximumItem = List.MaximumItem(join)
code_block_2 = CodeBlock(x=distanceTo, min=minimumItem, max=maximumItem, a=amplitude) { ((x-min)/(max-min))*a; }
code_block_3 = CodeBlock(x=distanceTo_2, min=minimumItem, max=maximumItem, a=amplitude) { ((x-min)/(max-min))*a; }
min = Math.Min(code_block_2, code_block_3)
translate = Geometry.Translate(geometry=byCoordinates, direction=ZAxis, distance=min)
byControlPoints = NurbsSurface.ByControlPoints(controlVertices=translate)

# group: Script Inputs
of_agents = IntegerSlider(25, range=0..100 step 1)
max_of_steps = IntegerSlider(25, range=0..100 step 1)
descend = BoolSelector(true)

python_script = Python(IN[0]=byControlPoints, IN[1]=of_agents, IN[2]=max_of_steps, IN[3]=descend)
# ---------- python_script.python (93 lines) ----------
### STEEPEST PATH ALGORITHM

# IMPORT LIBRARIES
import sys
sys.path.append('C:\Program Files (x86)\IronPython 2.7\Lib')
import random
import math
import clr
clr.AddReference('ProtoGeometry')
from Autodesk.DesignScript.Geometry import *

# DEFINE PARAMETER INPUTS
surfIn = IN[0]
numAgents = IN[1]
maxSteps = IN[2]
decendBoo = IN[3]


# DEFINE AGENT CLASS
class Agent(object):
    def get_step_size():
        area = surfIn.Area
        stepSize = math.sqrt(area)/100
        return stepSize
    
    zVec = Vector.ZAxis()
    stepSize = get_step_size()
    dupTol = 0.001
    
    
    def __init__(self,u,v):
        self.endBoo = False
        self.U = u
        self.V = v
        self.Z = None
        self.trailPts = []
        self.update_trail()

    def update(self):
        if not self.endBoo:
            positionPt01 = self.trailPts[-1]
            normalVec = surfIn.NormalAtParameter(self.U,self.V)
            gradientVec = Vector.Cross(self.zVec, normalVec)
            if decendBoo:
            	gradientVec = gradientVec.Rotate(normalVec,-90)
            	
            gradientVec = gradientVec.Normalized()
            gradientVec = gradientVec.Scale(self.stepSize)
            positionPt02 = positionPt01 + gradientVec
            newPt = surfIn.ClosestPointTo(positionPt02)
            newUV = surfIn.UVParameterAtPoint(newPt)
            newU, newV = newUV.U, newUV.V
            newZ = newPt.Z
           
            if decendBoo and (self.Z <= newZ):
            	self.endBoo = True
            else:
	            if ((abs(self.U-newU) <= self.dupTol) and (abs(self.V-newV) <= self.dupTol)):
	                self.endBoo = True
	            else:
	                self.U, self.V = newU, newV
	                self.update_trail()
	                 
    def update_trail(self):
        trailPt = surfIn.PointAtParameter(self.U,self.V)
        self.trailPts.append(trailPt)
        self.Z = trailPt.Z
        
  
# INITIALIZE AGENTS
agents = []
for i in range(numAgents):
	u = float(random.randrange(1000))/1000
	v = float(random.randrange(1000))/1000
	agent = Agent(u,v)
	agents.append(agent)
	

# UPDATE AGENTS
for i in range(maxSteps):
	for eachAgent in agents:
		eachAgent.update()
		
# DRAW TRAILS
trails = []
for eachAgent in agents:
	trailPts = eachAgent.trailPts
	if (len(trailPts) > 1):
		trail = PolyCurve.ByPoints(trailPts)
		trails.append(trail)

# OUTPUT TRAILS
OUT = trails
# ----------------------------------------
