# Dynamo graph 9-4_roomLookupIndex.dyn (Dynamo 2.0.0.4654)

# group: Collect all rooms in the model.
categories = Categories(index=416)
all_elements_of_category = ElementsOfCategory(Category=categories)

# group: Room Number To Find
string = StringInput("201")

# group: Get the room number and find what index it is at.
number = Room.Number(room=all_elements_of_category)
indexOf = List.IndexOf(list=number, element=string)

# group: Obtain the room at the index.
getItemAtIndex = List.GetItemAtIndex(list=all_elements_of_category, index=indexOf)
