# Dynamo custom node patternFromSolidModule.dyf (Dynamo 0.8.3.2391)
# category: Geometry.Solid
# Creates a pattern by arraying and rotating a solid module

solid = Input(solid:Solid)
seed = Input(seed:int = 3)
xCount = Input(xCount:int = 10)
yCount = Input(yCount:int = 10)
python_script = Python(IN[0]=solid, IN[1]=seed, IN[2]=xCount, IN[3]=yCount)
# ---------- python_script.python (45 lines) ----------
import clr
clr.AddReference('ProtoGeometry')
from Autodesk.DesignScript.Geometry import *

#The inputs to this node will be stored as a list in the IN variables.
solid = IN[0]
val = IN[1]
xCount = IN[2]
yCount = IN[3]

#create an empty list for the arrayed solids
solids = []
#create an empty list for the edge curves
crvs = []
#create number ranges for X and Y
xRange = list(range(xCount))
yRange = list(range(yCount))

#Get edges and convert to curve geometry - we need these curves due to a bounding box bug
edges = solid.Edges
for edge in edges:
	crvs.append(edge.CurveGeometry)
	
#Get the bounding box of the curves
bbox = BoundingBox.ByGeometry(crvs)

#Get the X and Y translation distance based on the bounding box
yDist = bbox.MaxPoint.Y-bbox.MinPoint.Y
xDist = bbox.MaxPoint.X-bbox.MinPoint.X

#Loop through X and Y
for i in xRange:
	for j in yRange:
		#get the source coordinate system
		fromCoord = solid.ContextCoordinateSystem
		#Rotate and translate the coordinate system
		toCoord = fromCoord.Rotate(solid.ContextCoordinateSystem.Origin,Vector.ByCoordinates(0,0,1),(90*(i+j%val)))
		vec = Vector.ByCoordinates((xDist*i),(yDist*j),0)
		toCoord = toCoord.Translate(vec)
		#Transform the solid from the source coordinate system to the target coordinate system and append to the list
		solids.append(solid.Transform(fromCoord,toCoord))


#Assign your output to the OUT variable.
OUT = solids
# ----------------------------------------
solids = Output(python_script)
