# Dynamo custom node patternFromSolidModule.dyf (Dynamo 2.8.0.2182)
# category: DynamoPrimer.Geometry.Solid
# Create petterns by arraying and rotating a solid module.

solid = Input(solid: Autodesk.DesignScript.Geometry.Solid)  # the solid to use
seed = Input(seed: int = 3)  # seed to provide options
xCount = Input(xCount: int = 10)  # number in the x direction
yCount = Input(yCount: int = 10)  # number in the y direction
python_script = Python(IN[0]=solid, IN[1]=seed, IN[2]=xCount, IN[3]=yCount)  # CPython3
# ---------- python_script.python (38 lines) ----------
import clr
clr.AddReference('ProtoGeometry')
from Autodesk.DesignScript.Geometry import *
#The inputs to this node will be stored as a list in the IN variables.
solid = IN[0]
seed = IN[1]
xCount = IN[2]
yCount = IN[3]

solids = []
crvs = []

edges = solid.Edges
for edge in edges:
	crvs.append(edge.CurveGeometry)
	
bbox = BoundingBox.ByGeometry(crvs)
yDist = bbox.MaxPoint.Y-bbox.MinPoint.Y
xDist = bbox.MaxPoint.X-bbox.MinPoint.X

xRange = list(range(xCount))
yRange = list(range(yCount))

fromCoord = solid.ContextCoordinateSystem
 
#Loop through X and Y
for i in xRange:
	for j in yRange:
		#Rotate and translate the coordinate system
		toCoord = fromCoord.Rotate(solid.ContextCoordinateSystem.Origin,Vector.ByCoordinates(0,0,1),(90*(i+j%seed)))
		vec = Vector.ByCoordinates((xDist*i),(yDist*j),0)
		toCoord = toCoord.Translate(vec)
		#Transform the solid from the source coordinate system to the target coordinate system and append to the list
		solids.append(solid.Transform(fromCoord,toCoord))


#Assign your output to the OUT variable.
OUT = solids
# ----------------------------------------
solids = Output(python_script)  # the resulting solids
