# Dynamo custom node PeakAndTroughSrf.dyf (Dynamo 0.8.2.2032)
# category: Samples

code_block = CodeBlock()
# ---------- code_block.designscript (6 lines) ----------
t7 = Rectangle.ByWidthLength(100,100).Patch();
t6 = (0..1..#10);
t9 = t7<1>.PointAtParameter(t6<2>, t6<3>);
t10 = t7.UVParameterAtPoint(t9);
t12 = MapTo(0, 1, t10.U, (-Math.PI) / 2, (Math.PI) / 2);
t14 = MapTo(0, 1, t10.V, 0, Math.PI);
# ----------------------------------------
code_block_2 = CodeBlock(u=code_block.t12, v=code_block.t14)
# ---------- code_block_2.designscript (11 lines) ----------
uTrig=Math.RadiansToDegrees(u);
vTrig=Math.RadiansToDegrees(v);
Cx=Math.Cos(uTrig);
Cy=Math.Sin(uTrig);
Cz=v;
Sx=Math.Sin(vTrig)*Cx;
Sy=Math.Sin(vTrig)*Cy;
Sz=Math.Cos(vTrig);
x=Cz*50+50;
y=Cy*50;
z=Sx*Sy*Sz*150;
# ----------------------------------------
byCoordinates = Point.ByCoordinates(x=code_block_2.x, y=code_block_2.y, z=code_block_2.z)
byControlPoints = NurbsSurface.ByControlPoints(controlVertices=byCoordinates)
Output = Output(byControlPoints)  # ""
