# Dynamo graph Revit-StructuralFraming.dyn (Dynamo 0.8.3.2256)

select_model_element = DSModelElementSelection()  # 1 picked in the model
select_model_element_2 = DSModelElementSelection()  # 1 picked in the model
number_slider = DoubleSlider(11, range=0..20 step 1)
code_block = CodeBlock(x=number_slider) { 0..1..#x; }
structural_framing_types = StructuralFramingTypes("W12X26")
levels = Levels("Level 1")
python_script = Python(IN[0]=select_model_element, IN[1]=select_model_element_2, IN[2]=code_block, IN[3]=structural_framing_types, IN[4]=levels)
# ---------- python_script.python (32 lines) ----------
import clr
#import Dynamo Geometry
clr.AddReference('ProtoGeometry')
from Autodesk.DesignScript.Geometry import *
# Import RevitNodes
clr.AddReference("RevitNodes")
import Revit
# Import Revit elements
from Revit.Elements import *
import System

#Query Revit elements and convert them to Dynamo Curves
crvA=IN[0].Curves[0]
crvB=IN[1].Curves[0]

#Define input Parameters
framingType=IN[3]
designLevel=IN[4]

#Define "out" as a list
OUT=[]

for val in IN[2]:
	#Define Dynamo Points on each curve
	ptA=Curve.PointAtParameter(crvA,val)
	ptB=Curve.PointAtParameter(crvB,val)
	#Create Dynamo line
	beamCrv=Line.ByStartPointEndPoint(ptA,ptB)
	#create Revit Element from Dynamo Curves
	beam = StructuralFraming.BeamByCurve(beamCrv,designLevel,framingType)
	#convert Revit Element into list of Dynamo Surfaces
	OUT.append(beam.Faces)
# ----------------------------------------
watch_3d = Watch3D(python_script)
