# Dynamo graph 9-4_roomDictionaryLevels.dyn (Dynamo 2.0.0.4654)

# group: Collect all rooms in the model.
categories = Categories(index=416)
all_elements_of_category = ElementsOfCategory(Category=categories)

# group: Get the level data to use as the key and group the rooms by like keys.
code_block = CodeBlock { "Level"; }
getParameterValueByName = Element.GetParameterValueByName(element=all_elements_of_category, parameterName=code_block)
groupByKey = List.GroupByKey(list=all_elements_of_category, keys=getParameterValueByName)

# group: Create Dictionary
byKeysValues = DesignScript.Builtin.Dictionary.ByKeysValues(keys=groupByKey.unique_keys, values=groupByKey.groups)

# group: Level name to lookup rooms with
levels = Levels(index=0)
name = Level.Name(level=levels)

# group: Get the room elements given the level
valueAtKey = DesignScript.Builtin.Dictionary.ValueAtKey(dictionary=byKeysValues, key=name)
