# Dynamo graph Transpose.dyn (Dynamo 0.8.1.1942)

integer_slider = IntegerSlider(5, range=-50..50 step 1)
integer_slider_2 = IntegerSlider(3, range=-50..50 step 1)
code_block = CodeBlock(Nx=integer_slider, Ny=integer_slider_2) { -50..50..#Nx; -50..50..#Ny; }
byCoordinates = Point.ByCoordinates(x=code_block.out0, y=code_block.out1, lacing=CrossProduct)
watch = Watch(byCoordinates)
byPoints = PolyCurve.ByPoints(points=watch)
transpose = List.Transpose(watch)
byPoints_2 = PolyCurve.ByPoints(points=transpose)
