# Dynamo graph Functions_SphereByZ.dyn (Dynamo 0.8.2.2032)

code_block = CodeBlock { 0..100..#5; }
byCoordinates = Point.ByCoordinates(x=code_block, z=code_block, lacing=CrossProduct)
code_block_2 = CodeBlock(thePoint=byCoordinates) { sphereByZ(thePoint); }
code_block_3 = CodeBlock { 0..100..#5; }
byCoordinates_2 = Point.ByCoordinates(y=code_block_3, z=code_block_3)
code_block_4 = CodeBlock(thePoint=byCoordinates_2) { sphereByZ(thePoint); }
code_block_5 = CodeBlock { 0..100..#5; }
byCoordinates_3 = Point.ByCoordinates(x=code_block_5, y=code_block_5, z=code_block_5, lacing=CrossProduct)
code_block_6 = CodeBlock(Pt=byCoordinates_3) { sphereByZ(Pt); }
code_block_7 = CodeBlock { -100..0..#5; }
byCoordinates_4 = Point.ByCoordinates(x=code_block_7, z=code_block_5, lacing=CrossProduct)
code_block_8 = CodeBlock()
# ---------- code_block_8.designscript (15 lines) ----------
/* This is the parent
code block, defining a function.
The text here is a multi-line comment
and does not affect the code. */

def sphereByZ(inputPt)
{
 //get inputPt variables
 sphereRadius=(inputPt.Z)/20;

 //define sphere
 sphere=Sphere.ByCenterPointRadius(inputPt,sphereRadius);
 //finally, define the function's output with 'return'
 return=sphere;
};
# ----------------------------------------
