# Dynamo graph Attractor Scale.dyn (Dynamo 0.9.2.4461)

arc_height = DoubleInput(3)

# group: Construct Surfaces
number = DoubleInput(10)
number_2 = DoubleInput(-10)
byCoordinates = Point.ByCoordinates(x=number, y=number_2)
byCoordinates_2 = Point.ByCoordinates(y=number_2)
byStartPointEndPoint = Line.ByStartPointEndPoint(startPoint=byCoordinates, endPoint=byCoordinates_2)
origin = Point.Origin()
number_3 = DoubleInput(10)
code_block = CodeBlock(x=number_3) { x/2; }
byCoordinates_3 = Point.ByCoordinates(x=code_block, z=arc_height)
byCoordinates_4 = Point.ByCoordinates(x=number_3)
byThreePoints = Arc.ByThreePoints(firstPoint=origin, secondPoint=byCoordinates_3, thirdPoint=byCoordinates_4)
create = List.Create(byStartPointEndPoint, byThreePoints)
byLoft = Surface.ByLoft(create)
translate = Geometry.Translate(geometry=byStartPointEndPoint, yTranslation=number)
create_2 = List.Create(byStartPointEndPoint, translate)
byLoft_2 = Surface.ByLoft(create_2)

u_coordinate = DoubleSlider(0.5, range=0..1 step 0.1)
v_coordinate = DoubleSlider(0.5, range=0..1 step 0.1)

# group: Attractor Point
pointAtParameter = Surface.PointAtParameter(surface=byLoft, u=u_coordinate, v=v_coordinate)
code_block_2 = CodeBlock { 0.2; }
byCenterPointRadius = Sphere.ByCenterPointRadius(centerPoint=pointAtParameter, radius=code_block_2)

count = IntegerSlider(15, range=5..20 step 1)
close_scale_factor = DoubleSlider(1, range=0.1..1 step 0.1)
far_scale_factor = DoubleSlider(0.1, range=0.1..1 step 0.1)

# group: Scale Rectangles based on distance
code_block_3 = CodeBlock(count=count) { start = 0.5*10/count; start..10..10/count; -start..-10..-10/count; 10/count; }
byCoordinates_5 = Point.ByCoordinates(x=code_block_3.out1, y=code_block_3.out2, lacing=CrossProduct)
flatten = Flatten(byCoordinates_5)
byOriginNormal = Plane.ByOriginNormal(origin=flatten)
pointAtParameter_2 = Surface.PointAtParameter(surface=byLoft_2, u=u_coordinate, v=v_coordinate)
distanceTo = Geometry.DistanceTo(geometry=flatten, other=pointAtParameter_2)
remapRange = Math.RemapRange(numbers=distanceTo, newMin=close_scale_factor, newMax=far_scale_factor)
mul = code_block_3.out3 * remapRange
byWidthLength = Rectangle.ByWidthLength(plane=byOriginNormal, width=mul, length=mul)

# group: Map Rectangles to Surface
points = Polygon.Points(byWidthLength)
UVParameterAtPoint = Surface.UVParameterAtPoint(byLoft_2, points)
U = UV.U(UVParameterAtPoint)
V = UV.V(UVParameterAtPoint)
pointAtParameter_3 = Surface.PointAtParameter(surface=byLoft, u=U, v=V)
byPoints = Polygon.ByPoints(pointAtParameter_3)
byPatch = Surface.ByPatch(byPoints)

close_color = StringInput("0,0,255")
color_surfaces = BoolSelector(true)
far_color = StringInput("255,0,255")

# group: Color Range from Strings
string = StringInput(",")
split = String.Split(close_color, string)
toNumber = String.ToNumber(split)
code_block_4 = CodeBlock { 0; 1; 2; }
getItemAtIndex = List.GetItemAtIndex(list=toNumber, index=code_block_4.out0)
getItemAtIndex_2 = List.GetItemAtIndex(list=toNumber, index=code_block_4.out1)
getItemAtIndex_3 = List.GetItemAtIndex(list=toNumber, index=code_block_4.out2)
byARGB = Color.ByARGB(r=getItemAtIndex, g=getItemAtIndex_2, b=getItemAtIndex_3)
filterByBoolMask = List.FilterByBoolMask(list=byARGB, mask=color_surfaces)
code_block_5 = CodeBlock { 150; }
byARGB_2 = Color.ByARGB(r=code_block_5, g=code_block_5, b=code_block_5)
filterByBoolMask_2 = List.FilterByBoolMask(list=byARGB_2, mask=color_surfaces)
create_3 = List.Create(filterByBoolMask.in, filterByBoolMask_2.out)
flatten_2 = Flatten(create_3)
string_2 = StringInput(",")
split_2 = String.Split(far_color, string_2)
toNumber_2 = String.ToNumber(split_2)
code_block_6 = CodeBlock { 0; 1; 2; }
getItemAtIndex_4 = List.GetItemAtIndex(list=toNumber_2, index=code_block_6.out0)
getItemAtIndex_5 = List.GetItemAtIndex(list=toNumber_2, index=code_block_6.out1)
getItemAtIndex_6 = List.GetItemAtIndex(list=toNumber_2, index=code_block_6.out2)
byARGB_3 = Color.ByARGB(r=getItemAtIndex_4, g=getItemAtIndex_5, b=getItemAtIndex_6)
filterByBoolMask_3 = List.FilterByBoolMask(list=byARGB_3, mask=color_surfaces)
create_4 = List.Create(filterByBoolMask_3.in, filterByBoolMask_2.out)
flatten_3 = Flatten(create_4)
create_5 = List.Create(flatten_2, flatten_3)
flatten_4 = Flatten(create_5)
code_block_7 = CodeBlock { {0,1}; }
code_block_8 = CodeBlock { 0; 1; }
remapRange_2 = Math.RemapRange(numbers=distanceTo, newMin=code_block_8.out0, newMax=code_block_8.out1)
color_range = ColorRange(flatten_4, code_block_7, remapRange_2)

# group: Color Based on Distance
byGeometryColor = Display.Display.ByGeometryColor(byPatch, color_range)
